# Grasshopper definition furniture.gh (Grasshopper 1.0.7)
# plug-ins: Weaverbird

legs_length_start_point = GetInteger(Slider(-15, range=-50..50), AtLeast=1, AtMost=1, Maximum=2147483647, Minimum=-2147483648, TreeAccess=False)
legs_height_start_point = GetInteger(Slider(0, range=-50..30), AtLeast=1, AtMost=1, Maximum=2147483647, Minimum=-2147483648, TreeAccess=False)
legs_width_end_point = GetInteger(Slider(15, range=-15..30), AtLeast=1, AtMost=1, Maximum=2147483647, Minimum=-2147483648, TreeAccess=False)
legs_width_start_point = GetInteger(Slider(-15, range=-50..50), AtLeast=1, AtMost=1, Maximum=2147483647, Minimum=-2147483648, TreeAccess=False)
legs_length_end_point = GetInteger(Slider(15, range=-50..50), AtLeast=1, AtMost=1, Maximum=2147483647, Minimum=-2147483648, TreeAccess=False)
legs_height_end_point = GetInteger(Slider(30, range=-50..50), AtLeast=1, AtMost=1, Maximum=2147483647, Minimum=-2147483648, TreeAccess=False)
construct_domain = ConstructDomain(DomainStart=legs_length_start_point, DomainEnd=legs_length_end_point)
construct_domain_2 = ConstructDomain(DomainStart=legs_width_start_point, DomainEnd=legs_width_end_point)
construct_domain_3 = ConstructDomain(DomainStart=legs_height_start_point, DomainEnd=legs_height_end_point)
domain_box = DomainBox(Base=PlaneXY(0, 0, 0), X=construct_domain_2, Y=construct_domain, Z=construct_domain_3)
deconstruct_brep = DeconstructBrep(Brep=domain_box)  # -> Faces, Edges, Vertices
ucount = GetInteger(Slider(2, range=0..10), AtLeast=1, AtMost=1, Maximum=2147483647, Minimum=-2147483648, TreeAccess=False)
vcount = GetInteger(Slider(2, range=0..10), AtLeast=1, AtMost=1, Maximum=2147483647, Minimum=-2147483648, TreeAccess=False)
mesh_surface = MeshSurface(Surface=deconstruct_brep.Faces, UCount=ucount, VCount=vcount, Overhang=True, Equalize=False)
weaverbird_s_picture_frame = WeaverbirdsPictureFrame(MeshPolylines=mesh_surface, Distance=5, InsetType=0)  # -> flatten(OutMesh)
thickness = Slider(2.2, range=0..10)
mesh_join = MeshJoin(Meshes=weaverbird_s_picture_frame)
thickness_2 = GetInteger(thickness, AtLeast=1, AtMost=1, Maximum=2147483647, Minimum=-2147483648, TreeAccess=False)
smoothness = Slider(3, range=1..3)
weaverbird_s_mesh_thicken = WeaverbirdsMeshThicken(MeshCurves=mesh_join, Distance=thickness_2, OffsetType=0)
smoothness_2 = GetInteger(smoothness, AtLeast=1, AtMost=1, Maximum=2147483647, Minimum=-2147483648, TreeAccess=False)
weaverbird_s_catmull_clark_subdivision = WeaverbirdsCatmullClarkSubdivision(MeshCurves=weaverbird_s_mesh_thicken, Level=smoothness_2, SmoothNakedEdges=1)
deconstruct_mesh = DeconstructMesh(Mesh=weaverbird_s_catmull_clark_subdivision)  # -> Vertices, Faces, Colours, Normals
construct_mesh = ConstructMesh(Vertices=deconstruct_mesh.Vertices, Faces=deconstruct_mesh.Faces, Colours=ColourSwatch(SwatchColor=RGB(243, 31, 255)))

# ---- group: RH_OUT: Furniture Leg
context_bake = ContextBake(Geometry=construct_mesh)
